# Dynamo graph roomRenumber - Rev2(working).dyn (Dynamo 1.3.3.4651)

# note: **Rhythm v.2018.8.27
placedRooms = Custom[Collector.PlacedRooms]()  # This will collect placed rooms in current file.
select_model_element = DSModelElementSelection()  # 1 picked in the model
curve = CurveElement.Curve(select_model_element)

# group: Intersect the rooms with the spline and get the first intersecting point.
# note: **Rhythm v.2018.8.27
intersectWithCurve = Rhythm.Revit.Elements.Room.IntersectWithCurve(placedRooms, curve)
create = List.Create(placedRooms, intersectWithCurve)
transpose = List.Transpose(create)
isEmpty = List.IsEmpty(intersectWithCurve@L2)
filterByBoolMask = List.FilterByBoolMask(list=transpose, mask=isEmpty)
firstItem = List.FirstItem(filterByBoolMask.out@L3)
lastItem = List.LastItem(filterByBoolMask.out@L3)
firstItem_2 = List.FirstItem(lastItem@L2)
startPoint = Curve.StartPoint(firstItem_2)

parameterAtPoint = Curve.ParameterAtPoint(curve=curve, point=startPoint)
sortByKey = List.SortByKey(list=firstItem, keys=parameterAtPoint)
code_block = CodeBlock { "Number"; }
number = DoubleInput(100)
code_block_2 = CodeBlock(startNumber=number, rooms=sortByKey.sorted_list) { startNumber..#Count(rooms)..1; }
string_from_object = FromObject(code_block_2)
setParameterByName = Element.SetParameterByName(element=sortByKey.sorted_list, parameterName=code_block, value=string_from_object)
