# Dynamo graph EX-01_GetFamilyCategoriesFromDirectory.dyn (Dynamo 1.3.3.4651)
# This graph is supplied under the GNU license version 3 by Parallax Team.

# group: Obtain the family files from the directory (without opening them)
string = StringInput("\\Prlx2\Marketing\Lectures\2018- AU- GitItTogether\_dataset\EX-01_GetFamilyCategories\_familiesToAudit")
fromPath = DirectoryObject(string)  # "Directory.FromPath"
code_block = CodeBlock { "*.rfa"; }
contents = Directory.Contents(fromPath, code_block)
readText = File.ReadText(contents)

# group: Obtain the start and end of where the category is identified
string_2 = StringInput("<category>")
lastIndexOf = String.LastIndexOf(readText, string_2)
string_3 = StringInput("</category>")
lastIndexOf_2 = String.LastIndexOf(readText, string_3)

# group: Obtain the string between the integers previously retrieved
sub = lastIndexOf_2 - lastIndexOf
substring = String.Substring(str=readText, startIndex=lastIndexOf, length=sub)

# group: Split the string up to get the plain category name
code_block_2 = CodeBlock { "<term>"; "</term>"; }
split = String.Split(substring, code_block_2.out0, code_block_2.out1)
code_block_3 = CodeBlock { 1; }
getItemAtIndex = List.GetItemAtIndex(list=split@L2, index=code_block_3)
